# Grasshopper definition GrasshopperCustomColourmap.gh (Grasshopper 1.0.7)

divisions = Slider(100, range=1..100)
rectangle_2pt = Rectangle2Pt(Plane=PlaneXY(0, 0, 0), PointA=Point(0, 0, 0), PointB="{20,5,0}", Radius=0)  # -> Rectangle, Length
surface = Surface(rectangle_2pt.Rectangle)
divide_domain² = DivideDomain²(Domain=surface, UCount=expr("x+1", divisions), VCount=1)
range = Range(Domain=Domain(0, 1), Steps=divisions)
isotrim = Isotrim(Surface=rectangle_2pt.Rectangle, Domain=divide_domain²)
ghpython_script = GhPythonScript(ColourMap="plasma", Value=range)  # -> out, ValueColour
# ---------- ghpython_script: Python ----------
"""Custom Colour Mapping Component
    Inputs:
        ColourMap: Name of the colour map
        Colour: Value to map to colour
    Output:
        ValueColour: The a output variable"""

__author__ = "Mitchell.Tesch"
__version__ = "2022.07.29"

import rhinoscriptsyntax as rs
import Rhino as rh
import math

# Colour Map RGB Data from the following sources:
# turbo by Anton Mikhailov - https://gist.github.com/mikhailov-work/ee72ba4191942acecc03fe6da94fc73f
# viridis, plasma, inferno, magma, cividis, hot, coolwarm, spectral, seismic by Matplotlib - https://matplotlib.org/stable/tutorials/colors/colormaps.html
# batlow, tokyo, buda, imola, vik, roma, bam, berlin by Fabio Crameri ScientificColourMaps7 - https://www.fabiocrameri.ch/colourmaps/

# Interpolation method adapted from script by Anton Mikhailov - https://gist.github.com/mikhailov-work/ee72ba4191942acecc03fe6da94fc73f

colour_maps = {'turbo':[[0.18995,0.07176,0.23217],[0.19483,0.08339,0.26149],[0.19956,0.09498,0.29024],[0.20415,0.10652,0.31844],[0.20860,0.11802,0.34607],[0.21291,0.12947,0.37314],[0.21708,0.14087,0.39964],[0.22111,0.15223,0.42558],[0.22500,0.16354,0.45096],[0.22875,0.17481,0.47578],[0.23236,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
               'viridis':[[0.267, 0.00487, 0.32942], [0.26851, 0.00961, 0.33543], [0.26994, 0.01462, 0.34138], [0.27131, 0.01994, 0.34727], [0.27259, 0.02556, 0.35309], [0.27381, 0.0315, 0.35885], [0.27495, 0.03775, 0.36454], [0.27602, 0.04417, 0.37016], [0.27702, 0.05034, 0.37572], [0.27794,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
               'plasma':[[0.05038, 0.0298, 0.52798], [0.06354, 0.02843, 0.53312], [0.07535, 0.02721, 0.53801], [0.08622, 0.02612, 0.54266], [0.09638, 0.02516, 0.5471], [0.10598, 0.02431, 0.55137], [0.11512, 0.02356, 0.55547], [0.1239, 0.02288, 0.55942], [0.13238, 0.02226, 0.56325], [0.1406, 0.02169,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
               'inferno':[[0.00146, 0.00047, 0.01387], [0.00227, 0.00127, 0.01857], [0.0033, 0.00225, 0.02424], [0.00455, 0.00339, 0.03091], [0.00601, 0.00469, 0.03856], [0.00768, 0.00614, 0.04684], [0.00956, 0.00771, 0.05514], [0.01166, 0.00942, 0.06346], [0.014, 0.01122, 0.07186], [0.01656,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
               'magma':[[0.00146, 0.00047, 0.01387], [0.00226, 0.0013, 0.01833], [0.00328, 0.00231, 0.02371], [0.00451, 0.00349, 0.02996], [0.00595, 0.00484, 0.03713], [0.00759, 0.00636, 0.04497], [0.00943, 0.00802, 0.05284], [0.01146, 0.00983, 0.06075], [0.01371, 0.01177, 0.06867], [0.01616,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
               'cividis':[[0.0, 0.13511, 0.30475], [0.0, 0.13807, 0.31111], [0.0, 0.14101, 0.31758], [0.0, 0.14395, 0.32398], [0.0, 0.14688, 0.33048], [0.0, 0.14979, 0.33706], [0.0, 0.15267, 0.3437], [0.0, 0.15538, 0.3505], [0.0, 0.15793, 0.35752], [0.0, 0.1605, 0.36453], [0.0, 0.16306, 0.37161],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
               'cool':[[0.0, 1.0, 1.0], [0.00392, 0.99608, 1.0], [0.00784, 0.99216, 1.0], [0.01176, 0.98824, 1.0], [0.01569, 0.98431, 1.0], [0.01961, 0.98039, 1.0], [0.02353, 0.97647, 1.0], [0.02745, 0.97255, 1.0], [0.03137, 0.96863, 1.0], [0.03529, 0.96471, 1.0], [0.03922, 0.96078, 1.0], [0.04314,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
               'hot':[[0.0416, 0.0, 0.0], [0.05189, 0.0, 0.0], [0.06219, 0.0, 0.0], [0.07248, 0.0, 0.0], [0.08278, 0.0, 0.0], [0.09307, 0.0, 0.0], [0.10337, 0.0, 0.0], [0.11366, 0.0, 0.0], [0.12396, 0.0, 0.0], [0.13425, 0.0, 0.0], [0.14455, 0.0, 0.0], [0.15484, 0.0, 0.0], [0.16514, 0.0, 0.0],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
               'coolwarm':[[0.22981, 0.29872, 0.75368], [0.23438, 0.30554, 0.75968], [0.23895, 0.31237, 0.76568], [0.24352, 0.31919, 0.77167], [0.24809, 0.32601, 0.77767], [0.25266, 0.33284, 0.78367], [0.25723, 0.33966, 0.78966], [0.26181, 0.34648, 0.79566], [0.26638, 0.3533, 0.80164], [0.2711,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
               'spectral':[[0.61961, 0.00392, 0.25882], [0.62807, 0.0133, 0.26082], [0.63652, 0.02268, 0.26282], [0.64498, 0.03206, 0.26482], [0.65344, 0.04145, 0.26682], [0.6619, 0.05083, 0.26882], [0.67036, 0.06021, 0.27082], [0.67882, 0.06959, 0.27282], [0.68727, 0.07897, 0.27482], [0.69573,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
               'seismic':[[0.0, 0.0, 0.3], [0.0, 0.0, 0.31098], [0.0, 0.0, 0.32196], [0.0, 0.0, 0.33294], [0.0, 0.0, 0.34392], [0.0, 0.0, 0.3549], [0.0, 0.0, 0.36588], [0.0, 0.0, 0.37686], [0.0, 0.0, 0.38784], [0.0, 0.0, 0.39882], [0.0, 0.0, 0.4098], [0.0, 0.0, 0.42078], [0.0, 0.0, 0.43176], [0.0,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
               'batlow':[[0.0051932, 0.098238, 0.34984], [0.0090652, 0.10449, 0.35093], [0.012963, 0.11078, 0.35199], [0.01653, 0.11691, 0.35307], [0.019936, 0.12298, 0.35412], [0.023189, 0.12904, 0.35518], [0.026291, 0.13504, 0.35621], [0.029245, 0.14096, 0.35724], [0.032053, 0.14677, 0.35824],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
               'tokyo':[[0.10387, 0.056805, 0.20243], [0.10975, 0.059104, 0.20564], [0.11566, 0.061046, 0.20884], [0.1216, 0.063055, 0.21209], [0.12757, 0.064935, 0.21531], [0.13351, 0.066895, 0.21858], [0.13939, 0.068939, 0.22184], [0.14535, 0.070894, 0.22512], [0.15119, 0.072938, 0.22845],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
               'buda':[[0.70015, 0.0027445, 0.70061], [0.70019, 0.010833, 0.69719], [0.70023, 0.019196, 0.69378], [0.70026, 0.027497, 0.69041], [0.70028, 0.036129, 0.68707], [0.7003, 0.044535, 0.68375], [0.70032, 0.052201, 0.68047], [0.70033, 0.059479, 0.67723], [0.70034, 0.066138, 0.67402],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
               'imola':[[0.10144, 0.20011, 0.70019], [0.10328, 0.20301, 0.69881], [0.10496, 0.2059, 0.69742], [0.10673, 0.20873, 0.69605], [0.1083, 0.21157, 0.69466], [0.10998, 0.21437, 0.69329], [0.11152, 0.21716, 0.69191], [0.11307, 0.21994, 0.69053], [0.1145, 0.2227, 0.68917], [0.11603, 0.22544,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
               'vik':[[0.0013282, 0.069836, 0.37953], [0.0023664, 0.076475, 0.38352], [0.0033042, 0.083083, 0.38749], [0.0041459, 0.08959, 0.39148], [0.0048968, 0.095948, 0.39545], [0.0055632, 0.10227, 0.39941], [0.0061512, 0.1085, 0.40339], [0.0066676, 0.11469, 0.40734], [0.0071192, 0.12085,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
               'roma':[[0.49232, 0.090787, 7.635e-05], [0.49673, 0.1028, 0.0036753], [0.50113, 0.11403, 0.0071337], [0.50547, 0.12468, 0.010421], [0.50981, 0.13489, 0.013817], [0.51412, 0.14464, 0.016841], [0.5184, 0.15404, 0.01972], [0.52263, 0.16319, 0.022451], [0.52685, 0.17204, 0.025034],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
               'bam':[[0.39622, 0.0081199, 0.29605], [0.40507, 0.018136, 0.30473], [0.41391, 0.028663, 0.31342], [0.4227, 0.0401, 0.32208], [0.43148, 0.051043, 0.33072], [0.44019, 0.06117, 0.33935], [0.44885, 0.070776, 0.34792], [0.45745, 0.079825, 0.35645], [0.46599, 0.088578, 0.36492], [0.47448,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
               'berlin':[[0.62108, 0.69018, 0.99951], [0.61216, 0.68923, 0.99537], [0.6032, 0.68825, 0.99124], [0.5942, 0.68726, 0.98709], [0.58517, 0.68625, 0.98292], [0.57609, 0.68522, 0.97873], [0.56696, 0.68417, 0.97452], [0.55779, 0.6831, 0.97029], [0.54859, 0.68199, 0.96602], [0.53933,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
               }

def interpolate(colour_map, v):
  v = max(0.0, min(1.0, v))
  a = int(v*255.0)
  b = min(255, a + 1)
  f = v*255.0 - a
  return rs.CreateColor(math.floor((colour_map[a][0] + (colour_map[b][0] - colour_map[a][0]) * f) * 255),
                        math.floor((colour_map[a][1] + (colour_map[b][1] - colour_map[a][1]) * f) * 255),
                        math.floor((colour_map[a][2] + (colour_map[b][2] - colour_map[a][2]) * f) * 255))

def interpolate_or_clip(colour_map, v):
  if   v < 0.0: 
      return [0.0, 0.0, 0.0]
  elif v > 1.0:
      return [1.0, 1.0, 1.0]
  else:
      return interpolate(colour_map, v)

if ColourMap in colour_maps.keys():
    print(ColourMap)
    ValueColour = interpolate_or_clip(colour_map=colour_maps[ColourMap],v=Value)
else:
    print('ColourMap not one of %s.' %colour_maps.keys())
# ---------- end ghpython_script ----------
custom_preview = CustomPreview(Geometry=isotrim, Material=ghpython_script.ValueColour)
panel = Panel(ghpython_script.out)
